# Dynamo custom node Viewport_Collector.dyf (Dynamo 1.3.2.2480)
# category: ArupBimSF.Revit.ViewPorts and Boundaries
# Collect all Viewports in active doc

categories = Categories("Viewports")
all_elements_of_category = ElementsOfCategory(categories)
RunMe = Input(RunMe : bool = false)
filterByBoolMask = List.FilterByBoolMask(list=all_elements_of_category, mask=RunMe)
watch = Watch(filterByBoolMask.in)
Elements = Output(watch)
parameters = Element.Parameters(watch)
string_from_object = FromObject(parameters)
uniqueItems = List.UniqueItems()  # unwired: arg0
map = List.Map(list=string_from_object, f_x=uniqueItems)
code_block = CodeBlock { "View Name"; }
contains = String.Contains(str=map, searchFor=code_block)
filterByBoolMask_2 = List.FilterByBoolMask(list=map, mask=contains)
flatten = Flatten(filterByBoolMask_2.in)
code_block_2 = CodeBlock { ": "; false; }
string_remove_string_prior_to = Custom[String_Remove String Prior To Charachter](str=flatten, Character=code_block_2.out0, ignoreCase=code_block_2.out1)  # Remove String Prior To Charachter
trimWhitespace = String.TrimWhitespace(string_remove_string_prior_to)
code_block_3 = CodeBlock { "Title on Sheet"; }
getParameterValueByName = Element.GetParameterValueByName(element=watch, parameterName=code_block_3)
code_block_4 = CodeBlock { "test"; }
code_block_5 = CodeBlock { ""; }
eq = _ == code_block_5  # unwired: arg0
replaceByCondition = Replace(getParameterValueByName, code_block_4, eq)
code_block_6 = CodeBlock { 2; }
cycle = List.Cycle(amount=code_block_6)  # unwired: list
map_2 = List.Map(list=replaceByCondition, f_x=cycle)
flatten_2 = Flatten(map_2)
code_block_7 = CodeBlock { {"","test"}; }
count = List.Count(getParameterValueByName)
code_block_8 = CodeBlock(a=count) { a; }
cycle_2 = List.Cycle(list=code_block_7, amount=code_block_8)
eq_2 = flatten_2 == cycle_2
filterByBoolMask_3 = List.FilterByBoolMask(list=flatten_2, mask=eq_2)
eq_3 = trimWhitespace == filterByBoolMask_3.out
filterByBoolMask_4 = List.FilterByBoolMask(list=trimWhitespace, mask=eq_3)
ViewNames = Output(filterByBoolMask_4.out)
code_block_9 = CodeBlock { "Scale Value    1:"; }
getParameterValueByName_2 = Element.GetParameterValueByName(element=watch, parameterName=code_block_9)
ViewScale_1 = Output(getParameterValueByName_2)  # "ViewScale 1:x"
TitleOnSheet = Output(getParameterValueByName)
